# Dynamo graph Brick_dimensions.dyn (Dynamo 2.12.1.8246)
# packages: spring nodes 203.2.0, Clockwork for Dynamo 2.x 2.3.0

# group: Get Sheets/Views
boolean = BoolSelector(true)  # graph input
ꟿ_document_activeview = Custom[ꟿ Document.ActiveView](refresh=boolean)  # package spring nodes; Selects the current document's active view. Supports more view types than the built-in option. Will be depreciated once the bult in node works with all plan types.
type = Custom[View.Type](view=ꟿ_document_activeview)  # package Clockwork for Dynamo 2.x; Returns the type of a given view
string_from_object = FromObject(obj=type)
create = List.Create(item0=ꟿ_document_activeview)
views = Custom[Springs.Sheet.Views+](sheet=ꟿ_document_activeview)  # package spring nodes; Extracts all views and schedules (minus the revision schedule) placed on the input sheet (or sheets). Will be depreciated once the bult in node works with all plan types.
type_2 = Custom[View.Type](view=views.view_s)
code_block = CodeBlock(x=type_2)
# ---------- code_block.designscript (3 lines) ----------
x == "Elevation" ||
x == "FloorPlan" ||
x == "Section";
# ----------------------------------------
filterByBoolMask = List.FilterByBoolMask(list=views.view_s, mask=code_block)
create_2 = List.Create(item0=filterByBoolMask.in)
code_block_2 = CodeBlock(a=string_from_object, sview=create, mview=create_2)
# ---------- code_block_2.designscript (3 lines) ----------
a != "DrawingSheet" ?
sview:
mview;
# ----------------------------------------
flatten = List.Flatten(list=code_block_2)

# group: Get dimension and filter
python_script = Python(IN[0]=flatten)  # IronPython2
# ---------- python_script.python (46 lines) ----------
import clr
clr.AddReference('ProtoGeometry')
from Autodesk.DesignScript.Geometry import *

#Import DocumentManager
clr.AddReference("RevitServices")
import RevitServices
from RevitServices.Persistence import DocumentManager
from RevitServices.Transactions import TransactionManager

#Import RevitAPI
clr.AddReference("RevitAPI")
import Autodesk

#Import ToDSType(bool) extension method
clr.AddReference("RevitNodes")
import Revit
from Autodesk.Revit.DB import *
from Autodesk.Revit.Creation import *
clr.ImportExtensions(Revit.Elements)
clr.ImportExtensions(Revit.GeometryConversion)


doc = DocumentManager.Instance.CurrentDBDocument
uidoc = DocumentManager.Instance.CurrentUIApplication.ActiveUIDocument
views = UnwrapElement(IN[0])
dimensionsperview = list()

TransactionManager.Instance.EnsureInTransaction(doc)

# collect dimensions in Views
for v in views:
	dimensions = list()	
	colldimension = FilteredElementCollector(doc, v.Id)
	filtdimension = ElementCategoryFilter(BuiltInCategory.OST_Dimensions)
	dimensions = colldimension.WherePasses(filtdimension).ToElements()
	#views = list()
	#views.append(cycle.v(dimensions.Count())	
	dimensionsperview.append(dimensions)
	
TransactionManager.Instance.TransactionTaskDone()

doc.Regenerate()
uidoc.RefreshActiveView()

OUT = dimensionsperview
# ----------------------------------------
code_block_3 = CodeBlock { "brickdimension"; }
filterByName = Custom[Elements.FilterByName](elements=python_script, searchString=code_block_3)  # package Clockwork for Dynamo 2.x; Retrieves those elements from a collection whose names match the search string
flatten_2 = List.Flatten(list=filterByName.in)

# group: Brick header size - set text
python_script_2 = Python(IN[0]=flatten_2)  # IronPython2
# ---------- python_script_2.python (60 lines) ----------
# Load the Python Standard and DesignScript Libraries
import clr
clr.AddReference('ProtoGeometry')
clr.AddReference('RevitServices')
import RevitServices
import math
from Autodesk.DesignScript.Geometry import *
from RevitServices.Persistence import DocumentManager
from RevitServices.Transactions import TransactionManager

doc = DocumentManager.Instance.CurrentDBDocument

# The inputs to this node will be stored as a list in the IN variables.
dimlines = UnwrapElement(IN[0])
brickheaderM = 102.5
jointM = 10
ftmmconversion = 304.8
brickwork_headersize = brickheaderM + jointM
brick_text = []

# Methods
def round_off_rating(number):
    return round(number * 2) / 2

def headersize_form(dim, brickheaderM, jointM):
	value_mm = round_off_rating(dim.Value * ftmmconversion)
	header_count = int(round(value_mm / (brickwork_headersize)))
	total_size_headers = (brickwork_headersize * header_count)
	additional_measurement = (value_mm - total_size_headers)
	total_headers = str(int(round(value_mm / (brickwork_headersize))))
    
	if value_mm % brickwork_headersize == jointM:
		result = total_headers + "B+J"
	elif value_mm % brickwork_headersize == brickheaderM:
		result = total_headers + "B-J"
	elif value_mm % brickwork_headersize == 0:
		result = total_headers + "B"
	elif value_mm % brickwork_headersize >= (brickwork_headersize / 2):
		result = str(int(math.ceil(value_mm / brickwork_headersize))) + "B " + str(additional_measurement) + "R" 
	else:
		result = str(int(value_mm // brickwork_headersize)) + "B+" + str(additional_measurement) + "R"
        
	dim.Below = result
	return result
    
TransactionManager.Instance.EnsureInTransaction(doc)
for dims in dimlines:
	if dims.Value == None:
		form = []
		for dim in dims.Segments:
			form.append(headersize_form(dim, brickheaderM, jointM))
		brick_text.append(form)
	else:
		form = []
		form.append(headersize_form(dims, brickheaderM, jointM))
		brick_text.append(form)
TransactionManager.Instance.TransactionTaskDone()

# Assign your output to the OUT variable
OUT = brick_text
# ----------------------------------------
