# Dynamo graph Renumber Grids.dyn (Dynamo 2.13.1.3887)
# packages: Clockwork for Dynamo 2.x 2.3.0, Data-Shapes 2019.2.42

# group: Select Grids
# Select grids
categories = Categories("OST_Grids")  # graph input
reset_grid_selecting = BoolSelector(false)  # graph input
select_model_elements_of = Custom[Select Model Elements of Category](categories, Toggle=reset_grid_selecting)  # package Data-Shapes; Allows to perform a manual selection with a category filter.

# group: Input Variables
# Input for grid labels
reverse_order_horizontal_grids = BoolSelector(false)  # graph input
reverse_order_vertical_grids = BoolSelector(false)  # graph input
prefix_label = StringInput("4")  # graph input
prefix_separator = StringInput(".")  # graph input
code_block = CodeBlock(Prefix_Label=prefix_label, Separator=prefix_separator) { Prefix_Label + Separator; }
prefix_yes_no = BoolSelector(true)  # graph input

# group: Separate Grids Horizontally and Vertically
# Separates grids and put it in two lists
# note: IN[0] = Selected Grids
# IN[1] = Reverse Horizontal Grid Order (Yes/No)
# IN[2] = Reverse Vertical Grid Order (Yes/No)
separate_grids_horizontally = Python(IN[0]=select_model_elements_of, IN[1]=reverse_order_horizontal_grids, IN[2]=reverse_order_vertical_grids)  # "Separate Grids Horizontally/Vertically"; IronPython2
# ---------- separate_grids_horizontally.python (29 lines) ----------
# Load the Python Standard and DesignScript Libraries
import clr
#Import RevitAPI
clr.AddReference("RevitAPI")
import Autodesk.Revit.DB as DB
import math

# The inputs to this node will be stored as a list in the IN variables.
grids = UnwrapElement(IN[0])
reverse_horizontal = IN[1]
reverse_vertical = IN[2]

# Separate gridlines by orientation
def separate_by_orientation(grids):
    h_grids = []
    v_grids = []
    for grid in grids:
        if isinstance(grid, DB.Grid) and not grid.IsCurved:
            vector = grid.Curve.GetEndPoint(0) - grid.Curve.GetEndPoint(1)
            angle = vector.AngleTo(DB.XYZ.BasisY) * (180/math.pi)
            if (45 <= angle <= 135) or (225 <= angle <= 315):
                h_grids.append(grid)
            else:
                v_grids.append(grid)
    return {
        "horizontal_grids": sorted(h_grids, key=lambda x: x.Curve.GetEndPoint(0).Y, reverse=reverse_horizontal),
        "vertical_grids": sorted(v_grids, key=lambda x: x.Curve.GetEndPoint(0).X, reverse=reverse_vertical)}
        
OUT = separate_by_orientation(grids)["vertical_grids"], separate_by_orientation(grids)["horizontal_grids"]
# ----------------------------------------
code_block_2 = CodeBlock(out=separate_grids_horizontally) { out[0]; out[1]; }

# group: Grid Labels in Numbers and Characters
# Labels for Horizontal and Vertical Grids
code_block_3 = CodeBlock { 1..100; }
boolean = BoolSelector(true)
fromNumber = Custom[Character.FromNumber](n=code_block_3, upperCase=boolean)  # package Clockwork for Dynamo 2.x; Converts a number into a character (where 1 = A, 2 = B, ... , 27 = AA, 28 = AB etc.).

# group: Renumber Grids
# Renumbering grids
# note: IN[0] = Vertical grids
# IN[1] = Horizontal grids
# IN[2] = Vertical grid labels
# IN[3] = Horizontal grid labels
# IN[4] = Prefix label
# IN[5] = Prefix toggle (Yes/No)
renumber_grids = Python(IN[0]=code_block_2.out0, IN[1]=code_block_2.out1, IN[2]=code_block_3, IN[3]=fromNumber, IN[4]=code_block, IN[5]=prefix_yes_no)  # IronPython2
# ---------- renumber_grids.python (56 lines) ----------
# Load the Python Standard and DesignScript Libraries
import clr
# Import DocumentManager
clr.AddReference("RevitServices")
import RevitServices
from RevitServices.Persistence import DocumentManager

#Import RevitAPI
clr.AddReference("RevitAPI")
from Autodesk.Revit.DB import *

# The inputs to this node will be stored as a list in the IN variables.
vertical_grids = UnwrapElement(IN[0])
horizontal_grids = UnwrapElement(IN[1])
vertical_grid_labels = IN[2]
horizontal_grid_labels = IN[3]
prefix = IN[4]
prefix_toggle = IN[5]

# Renumber grids
def Renumber(vertical_grids, horizontal_grids, vertical_grid_labels, horizontal_grid_labels, prefix, prefix_toggle):
    doc = DocumentManager.Instance.CurrentDBDocument
    with Transaction(doc) as t:
        t.Start("Refresh Grid labels")
        for i, grid in enumerate(vertical_grids):
            if i < len(vertical_grid_labels):
                if prefix_toggle:
                    grid.Name = "N/A-" + prefix + str(vertical_grid_labels[i])
                else:
                    grid.Name = "N/A-" + str(vertical_grid_labels[i])
        for i, grid in enumerate(horizontal_grids):
            if i < len(horizontal_grid_labels):
                if prefix_toggle:
                    grid.Name = "N/A-" + prefix + str(horizontal_grid_labels[i])
                else:
                    grid.Name = "N/A-" + str(horizontal_grid_labels[i])
        t.Commit()
    with Transaction(doc) as t:
        t.Start("Renumbering Grids")
        for i, grid in enumerate(vertical_grids):
            if i < len(vertical_grid_labels):            
                if prefix_toggle:
                    grid.Name = prefix + str(vertical_grid_labels[i])
                else:
                    grid.Name = str(vertical_grid_labels[i])
        for i, grid in enumerate(horizontal_grids):
            if i < len(horizontal_grid_labels):            
                if prefix_toggle:
                    grid.Name = prefix + str(horizontal_grid_labels[i])
                else:
                    grid.Name = str(horizontal_grid_labels[i])
        t.Commit()
    return {
    "vertical grids": vertical_grids, "horizontal grids" : horizontal_grids}
    
OUT = Renumber(vertical_grids, horizontal_grids, vertical_grid_labels, horizontal_grid_labels, prefix, prefix_toggle)
# ----------------------------------------
