# Dynamo graph Show Hide Level Bubbles.dyn (Dynamo 2.13.1.3887)
# packages: Clockwork for Dynamo 2.x 2.3.0, spring nodes 203.2.0

# group: Get Active View and Select which Level Bubbles to Show or Hide
# Get Active View with boolean and choose which Bubbles to Show
boolean = BoolSelector(true)  # graph input
active_view = Custom[Active View](refresh=boolean)  # package spring nodes; Selects the current document's active view. Supports more view types than the built-in option. Will be depreciated once the bult in node works with all plan types.
left_level_bubble_show_hide = BoolSelector(false)
right_level_bubble_show_hide = BoolSelector(false)

# group: Collect Single View
# Collect Single View
type = Custom[View.Type](view=active_view)  # package Clockwork for Dynamo 2.x; Returns the type of a given view
string_from_object = FromObject(object=type)
create = List.Create(item0=active_view)

# group: Collect Multiple Views When Sheet Is Active View
# Collect Multiple Views When Sheet Is Active View
views = Sheet.Views(sheet=active_view)
type_2 = Custom[View.Type](view=views)
code_block = CodeBlock(x=type_2)
# ---------- code_block.designscript (2 lines) ----------
x == "Elevation" ||
x == "Section";
# ----------------------------------------
filterByBoolMask = List.FilterByBoolMask(list=views, mask=code_block)
create_2 = List.Create(item0=filterByBoolMask.in)

# group: Filter Whether Single Or Multiple Views Get Through
# Filter Whether Single Or Multiple Views Get Through
code_block_2 = CodeBlock(a=string_from_object, sview=create, mview=create_2)
# ---------- code_block_2.designscript (3 lines) ----------
a != "DrawingSheet" ?
sview:
mview;
# ----------------------------------------
flatten = List.Flatten(list=[code_block_2, code_block_2, code_block_2, code_block_2, code_block_2, code_block_2])

# group: Turn On/Off Multiple Level Bubbles
# Turn On/Off Multiple Level Bubbles
turn_on_off_multiple_grid = Python(IN[0]=flatten, IN[1]=left_level_bubble_show_hide, IN[2]=right_level_bubble_show_hide)  # "Turn On/Off Multiple Grid Bubbles"; CPython3
# ---------- turn_on_off_multiple_grid.python (56 lines) ----------
import clr
# Import DocumentManager
clr.AddReference("RevitServices")
from RevitServices.Persistence import DocumentManager
from RevitServices.Transactions import TransactionManager

#Import RevitAPI
clr.AddReference("RevitAPI")
from Autodesk.Revit.DB import *

# The inputs to this node will be stored as a list in the IN variables.
doc = DocumentManager.Instance.CurrentDBDocument
uidoc = DocumentManager.Instance.CurrentUIApplication.ActiveUIDocument
views = UnwrapElement(IN[0])
leftbubbles = UnwrapElement(IN[1])
rightbubbles = UnwrapElement(IN[2])
annotationelements = list()

TransactionManager.Instance.EnsureInTransaction(doc)

# Gather all levels per view.
for view in views:
	collector = FilteredElementCollector(doc, view.Id)
	filter = ElementCategoryFilter(BuiltInCategory.OST_Levels)
	levels = collector.WherePasses(filter).ToElements()

	if leftbubbles == True:
		if rightbubbles == True:
			for level in levels:
				level.ShowBubbleInView(DatumEnds.End0, view)
				level.ShowBubbleInView(DatumEnds.End1, view)          
				out = "Bubbles on the left and Right are Shown"
		if rightbubbles == False:
			for level in levels:
				level.ShowBubbleInView(DatumEnds.End0, view)
				level.HideBubbleInView(DatumEnds.End1, view)
				out = "Bubbles on the left are Shown"
	elif rightbubbles == True and leftbubbles == False:
		for level in levels:
			level.ShowBubbleInView(DatumEnds.End1, view)
			level.HideBubbleInView(DatumEnds.End0, view)          
			out = "Bubbles on the right are Shown"
	else:
		for level in levels:
			level.HideBubbleInView(DatumEnds.End0, view)
			level.HideBubbleInView(DatumEnds.End1, view)
			out = "Bubbles are Hidden"              
	
	annotationelements.append(levels)

TransactionManager.Instance.TransactionTaskDone()
doc.Regenerate()
uidoc.RefreshActiveView()

# Assign your output to the OUT variable
OUT = (annotationelements, out)
# ----------------------------------------
code_block_3 = CodeBlock(out=turn_on_off_multiple_grid) { out[1]; }
